# Grasshopper definition definition.gh (Grasshopper 1.0.7)

# ---- group: generate Circles
random_variation_amplitude = Slider(0.1, range=0..1)
maximum_scale_factor = Slider(1.4, range=0..10)
minimum_scale_factor = Slider(0.6, range=0..1)
random_seed = Slider(8, range=0..12)
number_of_circles = Slider(7, range=0..12)
division_count = Slider(12, range=0..15)
vertical_spacing = Slider(4.1, range=0..12)
circle_radius = Slider(9, range=0..12)
panel = Panel("{12,12,0}")

# ----
python = GhPythonScript(
    base_center=panel,
    radius=circle_radius,
    ampli=vertical_spacing,
    count=number_of_circles,
    seed=random_seed,
    min_scale=minimum_scale_factor,
    max_scale=maximum_scale_factor,
    rand_amp=random_variation_amplitude,
    num_seg=division_count)  # -> crvs, rev_crvs, outline; inputs base_center: Point3d, radius: Int32, count: Int32, seed: Int32, num_seg: Int32
# ---------- python: Python ----------
import Grasshopper as ghc
import ghpythonlib.components as gh
import random

if seed is not None:
    random.seed(seed)


# ---------------------------------------------
# 1. Generate Circles
# ---------------------------------------------
def create_circles(base_center, radius, ampli, count):
    """Create vertically stacked circles."""
    if count < 2:
        raise ValueError("count must be at least 2")
    circle = gh.Circle(gh.XYPlane(base_center), radius)
    dup_circles = gh.LinearArray(circle, gh.UnitZ(ampli), count)[0]
    return dup_circles

# ---------------------------------------------
# 2. Scale Circles
# ---------------------------------------------
def scale_circles(circles, min_scale, max_scale,rand_amp):
    """Randomly scale each circle around its center."""
    scaled = []
    for i,crc in enumerate(circles):
        n = len(circles) - 1
        t = i / float(n) if n > 0 else 0
        if rand_amp < 0:
            raise ValueError("rand_amp must be >= 0")
        factor = (min_scale + (max_scale - min_scale) * t) * random.uniform(1 - rand_amp, 1 + rand_amp)
        area = gh.Area(crc)
        center = area[1]
        scaled.append(gh.Scale(crc, center, factor)[0])
    return scaled

# ---------------------------------------------
# 3. Divide Circles
# ---------------------------------------------
def divide_circles(scaled_circles, num_seg):
    """Divide circles into points stored in a DataTree."""
    points = ghc.DataTree[object]()
    if num_seg < 3:
        raise ValueError("num_seg must be at least 3")
    for i, crv in enumerate(scaled_circles):
        path = ghc.Kernel.Data.GH_Path(i)
        pts = gh.DivideCurve(crv, num_seg, False)[0]
        
        for pt in pts:
            points.Add(pt, path)
    return points

# ---------------------------------------------
# 4. Shift Lists
# ---------------------------------------------
def shift_lists(points):
    """Shift each branch and its reversed version."""
    shifted = ghc.DataTree[object]()
    reversed_shifted = ghc.DataTree[object]()
    
    for i in range(points.BranchCount):
        path = points.Path(i)
        branch = points.Branch(i)
        
        forward = gh.ShiftList(branch, i, True)
        backward = gh.ShiftList(gh.ReverseList(branch), i, True)
        
        for pt in forward:
            shifted.Add(pt, path)
            
        for pt in backward:
            reversed_shifted.Add(pt, path)
            
    return shifted, reversed_shifted

# ---------------------------------------------
# 5. Flip Matrix (DataTree Transpose)
# ---------------------------------------------
def transpose_tree(tree):
    """Flip DataTree structure (rows → columns)."""
    flipped = ghc.DataTree[object]()
    
    for i in range(tree.BranchCount):
        for j, item in enumerate(tree.Branch(i)):
            path = ghc.Kernel.Data.GH_Path(j)
            flipped.Add(item, path)
    
    return flipped


# ---------------------------------------------
# 6. Generate NURBS Curves
# ---------------------------------------------
def generate_curves(tree):
    """Interpolate curves from each branch."""
    curves = []
    
    for i in range(tree.BranchCount):
        curves.append(gh.Interpolate(tree.Branch(i), 3, False, 1)[0])
    
    return curves

# =============================================
# MAIN PIPELINE
# =============================================

circles = create_circles(base_center, radius, ampli, count)

scaled_circles = scale_circles(circles, min_scale, max_scale,rand_amp)

points = divide_circles(scaled_circles, num_seg)

shifted, reversed_shifted = shift_lists(points)

flipped = transpose_tree(shifted)
flipped_rev = transpose_tree(reversed_shifted)

crvs = generate_curves(flipped)
rev_crvs = generate_curves(flipped_rev)

outline = scaled_circles[:1] + scaled_circles[-1:]
# ---------- end python ----------
number_slider = Slider(0.06, range=0..0.1)
pipe = Pipe(Curve=python.outline, Radius=number_slider, Caps=0)
pipe_2 = Pipe(Curve=python.rev_crvs, Radius=number_slider, Caps=0)
pipe_3 = Pipe(Curve=python.crvs, Radius=number_slider, Caps=0)
brep = Brep(pipe)
brep_2 = Brep(pipe_3)
brep_3 = Brep(pipe_2)
wires = BrepWireframe(Brep=brep_2, Density=-1)
wires_2 = BrepWireframe(Brep=brep_3, Density=-1)
wires_3 = BrepWireframe(Brep=brep, Density=-1)
swatch = ColourSwatch(SwatchColor=RGB(255, 255, 255))
preview = CustomPreview(Geometry=brep_2, Material=ColourSwatch(SwatchColor=RGB(148, 71, 71)))
preview_2 = CustomPreview(Geometry=wires, Material=swatch)
preview_3 = CustomPreview(Geometry=brep_3, Material=ColourSwatch(SwatchColor=RGB(139, 148, 35)))
preview_4 = CustomPreview(Geometry=wires_2, Material=swatch)
preview_5 = CustomPreview(Geometry=brep, Material=ColourSwatch(SwatchColor=RGB(145, 181, 186)))
preview_6 = CustomPreview(Geometry=wires_3, Material=swatch)
